# Grasshopper definition scan_flow.gh (Grasshopper 1.0.7)
# plug-ins: SketchfabUpload

file = ReadFile(File="G:\マイドライブ\2021\04_Master\2104_Scan\00_ScanFlow\main_gh.py", PerLineParse=False)
python = GhPythonScript(Code=file, Selected_timber_id="210905_timber7", Flag=Toggle(False))  # -> Out, Geometry, Target_dir, Title, Description, Tags, IsPublished
panel = Panel(python.Out)
panel_2 = Panel(python.Target_dir)
panel_3 = Panel(python.Description)
panel_4 = Panel(python.Title)
panel_5 = Panel(python.Tags)
panel_6 = Panel(python.IsPublished)
geo = Geometry(python.Geometry)
sketchfab = SketchfabUpload(
    Run=Toggle(True),
    Geometry=flatten(geo),
    APIToken="c32d8c3d03894429a298943dd5829204",
    Directory=panel_2,
    Title=panel_4,
    Description=panel_3,
    Tags=panel_5,
    Private=panel_6)
panel_7 = Panel(sketchfab)
python_2 = GhPythonScript(x=panel_7)  # -> out
# ---------- python_2: Python ----------
import rhinoscriptsyntax as rs
import os

re = x.split(":")

re = re[2]

re = re.split('"')

base = "https://sketchfab.com/3d-models/"
path = base + re[1]
print path

out = path
# ---------- end python_2 ----------
text_to_code = Panel(python_2)
python_3 = GhPythonScript(x=panel_4, y=".png")  # -> name
# ---------- python_3: Python ----------
name = x + y
print name
# ---------- end python_3 ----------

expression = Expression(x=panel_2, y=python_3, Expression="x & \"/\" & y")
nomimage = Text(expression)

data_to_url_c_rfy = CSharpScript(data=text_to_code)  # -> out, url; inputs data: String
# ---------- data_to_url_c_rfy: C# usings ----------
using System.IO;
using System.Linq;
using System.Data;
using System.Drawing;
using System.Reflection;
using System.Windows.Forms;
using System.Xml;
using System.Xml.Linq;
using System.Runtime.InteropServices;

using Rhino.DocObjects;
using Rhino.Collections;
using GH_IO;
using GH_IO.Serialization;
# ---------- data_to_url_c_rfy: C# ----------
    url = "https://api.qrserver.com/v1/create-qr-code/?size=150x150&data=" + data;
# ---------- end data_to_url_c_rfy ----------
url = Text(data_to_url_c_rfy.url)

nomimage_2 = Text(nomimage)
url_to_bitmap_c_rfy = CSharpScript(url=url, NomImage=nomimage_2)  # -> out, bitmap, Chemin; inputs url: String, NomImage: String
# ---------- url_to_bitmap_c_rfy: C# ----------
    System.Net.WebRequest request = System.Net.WebRequest.Create(url);
    System.Net.WebResponse response = request.GetResponse();
    System.IO.Stream responseStream =
      response.GetResponseStream();
    Bitmap bitmap2 = new Bitmap(responseStream);
    bitmap2.Save(NomImage);
    bitmap = bitmap2;
    Chemin = NomImage;
# ---------- end url_to_bitmap_c_rfy ----------
path = Text(url_to_bitmap_c_rfy.Chemin)
bitmap = Data(url_to_bitmap_c_rfy.bitmap)
